# Dynamo graph ParkingLayoutTest.dyn (Dynamo 1.2.0.2690)

code_block = CodeBlock { 0; }
byCoordinates = Point.ByCoordinates(x=code_block, y=code_block, z=code_block)
integer_slider = IntegerSlider(7, range=0..100 step 1)
integer_slider_2 = IntegerSlider(4, range=0..100 step 1)
boolean = BoolSelector(false)
byLocation = SCDynamoNodes.ParkingLayout.ByLocation(byCoordinates, arg5=integer_slider, arg6=integer_slider_2, arg7=boolean)  # frozen
family_types = FamilyTypes("SC-Parking-Car_Space:5400 x 2400 - Residential")
placeFamily = Custom[PlaceFamily](parkingLayout=byLocation, familyType=family_types)
curve = CurveElement.Curve()  # frozen; unwired: arg0
angleOfCurve = Custom[AngleOfCurve](curve=curve)  # Get the angle between a curves startand end point
watch = Watch(angleOfCurve)
select_face = DSFaceSelection()  # 1 picked in the model
edges = Face.Edges(select_face)
watch_2 = Watch(edges)
flatten = Flatten(edges)
code_block_2 = CodeBlock { 0; }
getItemAtIndex = List.GetItemAtIndex(list=flatten, index=code_block_2)
curveGeometry = Edge.CurveGeometry(getItemAtIndex)
angleOfCurve_2 = Custom[AngleOfCurve](curve=curveGeometry)
watch_3 = Watch(angleOfCurve_2)
