# Dynamo graph PointTest.dyn (Dynamo 1.2.1.3083)

panelTriangleB = Geometry.Panel.PanelTriangleB()  # unwired: arg0, arg1, arg2
watch = Watch(panelTriangleB.out1)
code_block = CodeBlock { 1000; }
code_block_2 = CodeBlock { 10; }
code_block_3 = CodeBlock(x=code_block_2) { x * x; }
randomList = Math.RandomList(code_block_3)
code_block_4 = CodeBlock(x=code_block, z=randomList) { x * z * 2; }
create2dPointGridZ = Points.Create2dPointGridZ(code_block, code_block, code_block_2, code_block_2, code_block_4)
byPoints = NurbsSurface.ByPoints(create2dPointGridZ)
panelTriangleA = Geometry.Panel.PanelTriangleA(byPoints, code_block_2, code_block_2)
family_types = FamilyTypes("Family2:Family2")
byPoints_2 = AdaptiveComponent.ByPoints(points=panelTriangleA.out1, familyType=family_types)
sendTo = Custom[Clipboard.SendTo]()  # Copies a string to the clipboard.; unwired: str
