# Dynamo graph SightLinesTest.dyn (Dynamo 1.2.1.3083)

integer_slider = IntegerSlider(60, range=60..120 step 10)
n3_number_of_rows_in_lower_tier = IntegerSlider(13, range=1..36 step 1)  # "3. Number of rows in lower tier"
n2_boundary_line_to_first_row_of = CodeBlock { 4000; }  # "2. Boundary line to first row of lower seating"
byValues = SightLines.SightLines.ByValues(arg3=integer_slider, arg5=n3_number_of_rows_in_lower_tier, arg6=n2_boundary_line_to_first_row_of)
goingBackPoints = SightLines.SightLines.GoingBackPoints(byValues)
n1_number_of_rows_in_top_tier = IntegerSlider(16, range=1..36 step 1)  # "1. Number of rows in top tier"
treadSize = SightLines.SightLines.TreadSize(byValues)
numberOfRows = SightLines.SightLines.NumberOfRows(byValues)
code_block = CodeBlock(x=treadSize, y=numberOfRows, a=n2_boundary_line_to_first_row_of) { x*y + a; }
rows = SightLines.SightLines.Rows(byValues)
code_block_2 = CodeBlock(f=rows, x=numberOfRows) { f[x-1]; }
heightToFocus = SightLines.SightLinesRow.HeightToFocus(code_block_2)
code_block_3 = CodeBlock(x=heightToFocus) { x + 0; }
byValues_2 = SightLines.SightLines.ByValues(arg5=n1_number_of_rows_in_top_tier, arg6=code_block, arg7=code_block_3)
goingBackPoints_2 = SightLines.SightLines.GoingBackPoints(byValues_2)
create = List.Create(goingBackPoints, goingBackPoints_2)
flatten = Flatten(create)
pointValues = Points.PointValues(flatten)
count = List.Count(flatten)
randomList = Math.RandomList(count)
code_block_4 = CodeBlock(x=pointValues.out0, r=randomList) { x + r * 6000 + 6000; }
byCoordinates = Point.ByCoordinates(x=code_block_4, y=pointValues.out1, z=pointValues.out2)
byControlPoints = NurbsCurve.ByControlPoints(byCoordinates)
n4_select_boundary_line = DSModelElementSelection()  # "4. Select Boundary Line"; 1 picked in the model
curve = CurveElement.Curve(n4_select_boundary_line)
code_block_5 = CodeBlock { 0; }
coordinateSystemAtParameter = Curve.CoordinateSystemAtParameter(curve, code_block_5)
origin = CoordinateSystem.Origin(coordinateSystemAtParameter)
YAxis = CoordinateSystem.YAxis(coordinateSystemAtParameter)
code_block_6 = CodeBlock { 180; }
rotate = CoordinateSystem.Rotate(coordinateSystem=coordinateSystemAtParameter, origin=origin, axis=YAxis, degrees=code_block_6)
transform = Geometry.Transform(byControlPoints, rotate)
bySweep = Surface.BySweep(transform, curve)
watch = Watch(numberOfRows)
profileGeometry = SightLines.SightLines.ProfileGeometry(byValues_2)
transform_2 = Geometry.Transform(profileGeometry, rotate)
bySweep_2 = Surface.BySweep(transform_2, curve)
categories = Categories("Floors")
code_block_7 = CodeBlock { "Concrete, Precast"; }  # frozen
byName = Material.ByName(code_block_7)  # frozen
code_block_8 = CodeBlock { "upper_tier"; }
byGeometry = DirectShape.ByGeometry(geometry=bySweep_2, category=categories, material=byName, name=code_block_8)  # frozen
profileGeometry_2 = SightLines.SightLines.ProfileGeometry(byValues)
transform_3 = Geometry.Transform(profileGeometry_2, rotate)
bySweep_3 = Surface.BySweep(transform_3, curve)
code_block_9 = CodeBlock { "lower_tier"; }
byGeometry_2 = DirectShape.ByGeometry(geometry=bySweep_3, category=categories, material=byName, name=code_block_9)  # frozen
field = SelectFaces()  # 17 picked in the model
